# Grasshopper definition HEX PARAMETRIC SYSTEM v1 (3D PRINT IN MILLIMETERS).gh (Grasshopper 0.9.14)
# plug-ins: LunchBox, Weaverbird
# HEX CONSTRUCTION SYSTEM
# 
# More info about the project in http://pfc.angelpontes.net/

# ---- group: Origin Point
# HEX 2D BASE GRID
# DATA INPUT
# 
# Modify here the input parameters ​​to configure a custom hexagonal grid.
# 
# After setting the grid values as well as the 3D printed structural components, proceed to cut the resulting base with a CNC laser cutter on a surface (MDF, plywood or plastic, for example) with a few millimeters thickness in order to fix the column sticks.
# 
# Don't forget to set the size of all components (the grid and the building pieces) to the same scale always in millimeters (the radius of the hexagons and the circular column) before baking the file.
x_coordinate = Slider(0, range=0..10)
y_coordinate = Slider(0, range=0..10)

# ---- group: Hex Grid
hexagon_radius_mm = Slider(35, range=0..50)
nr_hex_x_axis = Slider(2, range=0..10)
nr_hex_y_axis = Slider(2, range=0..10)

# ---- group: Inner Tri-Grid Subdivisions
nr_subdivisions = Slider(7, range=0..10)

# ---- group: Holes (for column fixing)
# HEX 3D PRINTED CONSTRUCTION SYSTEM
column_diameter_mm = Slider(3, range=0..5)

# ---- group: Columns
# DATA INPUT
# 
# Set here the system basic parameters in accordance to your requirements.
height_mm = Slider(40, range=0..50)
section_radius_mm = Slider(1.5, range=0..5)
nr_of_building_levels = Slider(2, range=0..3)

# ---- group: Hex Beams Framework
h_section_height_m = Slider(3, range=0..5)
b_flange_width_mm = Slider(2, range=0..3)

# ---- group: Hex Slab/Deck
slab_thickness_mm = Slider(2, range=0..5)
deck_thickness_mm = Slider(3, range=0..5)

# ---- group: Tri-Grid Modulated Floor
nr_subdivisions_2 = Number(nr_subdivisions)
thickness_mm = Slider(0.4, range=0..1)
gap_width_mm = Slider(0.4, range=0..1)
panel = Panel(nr_subdivisions_2)

# ---- group: HEX GRID COMPONENTS / Base Plane
# HEXAGONAL 2D BASE GRID
# 
# GRASSHOPPER DEFINITION
origin = PointXYZ(XComponent=x_coordinate, YComponent=y_coordinate, ZComponent=0, System=PlaneXY(0, 0, 0))
direction = Slider(1, range=-1..1)
X = UnitX(Factor=direction)
Y = UnitY(Factor=direction)
pl = Plane(Origin=origin, XAxis=X, YAxis=Y)

# ---- group: HEX BUILDING SYSTEM COMPONENTS / Hex Polygon
hex_radius = Number(hexagon_radius_mm)
# HEXAGONAL 3D PRINTED
# 
# MODULAR BUILDING SYSTEM
# 
# GRASSHOPPER DEFINITION
origin_point = Point(origin)
nr_sides = Slider(6, range=0..6)
polygon = Polygon(Plane=origin_point, Radius=hex_radius, Segments=nr_sides, FilletRadius=0)  # -> Polygon, Length

# ---- group: Square Base Plate
width_mm = Slider(100, range=0..200)

# ---- group: HEX GRID COMPONENTS / Hex Grid
hexa_grid = Hexagonal(Plane=pl, Size=hexagon_radius_mm, ExtentX=nr_hex_x_axis, ExtentY=nr_hex_y_axis)  # -> Cells, Points

# ---- group: HEX GRID COMPONENTS / Square Base Plate
flatten = FlattenTree(Data=hexa_grid.Points, Path="{0}")
multiplication = Multiplication(A=width_mm, B=-1)
interp = InterpolateData(Data=flatten, Parameter=0.5, Interpolation=2)
dom = Domain(DomainStart=multiplication, DomainEnd=width_mm)
rectangle = Rectangle(Plane=interp, XSize=dom, YSize=dom, Radius=0)  # -> Rectangle, Length

# ----
square_base_plate = Rectangle(rectangle.Rectangle)

# ---- group: HEX GRID COMPONENTS / Holes (for stick/column fixing)
division = Division(A=column_diameter_mm, B=2)
cir = Circle(Plane=hexa_grid.Points, Radius=division)

# ----
circular_holes = Circle(cir)

# ---- group: HEX GRID COMPONENTS / Hex Radius
mcomp = Decompose(Mesh=hexa_grid.Cells)  # -> Vertices, Faces, Colours, Normals
vertex_nr = Slider(0, range=0..6)
vertex_nr_2 = Slider(1, range=0..6)
vertex_nr_3 = Slider(2, range=0..6)
vertex_nr_4 = Slider(3, range=0..6)
vertex_nr_5 = Slider(4, range=0..6)
vertex_nr_6 = Slider(5, range=0..6)
item = ListItem(List=mcomp.Vertices, Index=vertex_nr, Wrap=False)
item_2 = ListItem(List=mcomp.Vertices, Index=vertex_nr_2, Wrap=False)
item_3 = ListItem(List=mcomp.Vertices, Index=vertex_nr_3, Wrap=False)
item_4 = ListItem(List=mcomp.Vertices, Index=vertex_nr_4, Wrap=False)
item_5 = ListItem(List=mcomp.Vertices, Index=vertex_nr_5, Wrap=False)
item_6 = ListItem(List=mcomp.Vertices, Index=vertex_nr_6, Wrap=False)
ln = Line(StartPoint=item, EndPoint=item_4)
ln_2 = Line(StartPoint=item_2, EndPoint=item_5)
ln_3 = Line(StartPoint=item_3, EndPoint=item_6)

# ---- group: HEX BUILDING SYSTEM COMPONENTS / Cylinder Column
pt = PointXYZ(XComponent=x_coordinate, YComponent=y_coordinate, ZComponent=height_mm, System=PlaneXY(0, 0, 0))
ln_4 = Line(StartPoint=origin_point, EndPoint=pt)
cir_2 = Circle(Plane=pt, Radius=section_radius_mm)
cir_3 = Circle(Plane=origin_point, Radius=section_radius_mm)
cyl = Cylinder(Base=origin_point, Radius=section_radius_mm, Length=ln_4)
planar = PlanarSrf(Edges=cir_2)
planar_2 = PlanarSrf(Edges=cir_3)
join = BrepJoin(Breps=[planar, planar_2, cyl])  # -> Breps, Closed

# ---- group: HEX BUILDING SYSTEM COMPONENTS / + (Column Hole)
division_2 = Division(A=h_section_height_m, B=3)
multiplication_2 = Multiplication(A=division_2, B=2)
pt_2 = PointXYZ(XComponent=x_coordinate, YComponent=y_coordinate, ZComponent=multiplication_2, System=PlaneXY(0, 0, 0))
column_radius = Number(section_radius_mm)
ln_5 = Line(StartPoint=origin_point, EndPoint=pt_2)
cyl_2 = Cylinder(Base=origin_point, Radius=column_radius, Length=ln_5)
end = EndPoints(Curve=ln_5)  # -> Start, End
cir_4 = Circle(Plane=PlaneXY(0, 0, 0), Radius=column_radius)
cir_5 = Circle(Plane=end.End, Radius=column_radius)
planar_3 = PlanarSrf(Edges=cir_4)
planar_4 = PlanarSrf(Edges=cir_5)
join_2 = BrepJoin(Breps=[planar_3, planar_4, cyl_2])  # -> Breps, Closed

# ---- group: HEX BUILDING SYSTEM COMPONENTS / Hex Slab (Massive Solid)
planar_5 = PlanarSrf(Edges=polygon.Polygon)
Z = UnitZ(Factor=slab_thickness_mm)
extr = Extrude(Base=planar_5, Direction=Z)

# ---- group: HEX BUILDING SYSTEM COMPONENTS / + (Column Hole)
division_3 = Division(A=slab_thickness_mm, B=3)
multiplication_3 = Multiplication(A=division_3, B=2)
pt_3 = PointXYZ(XComponent=x_coordinate, YComponent=y_coordinate, ZComponent=multiplication_3, System=PlaneXY(0, 0, 0))
column_radius_2 = Number(section_radius_mm)
ln_6 = Line(StartPoint=origin_point, EndPoint=pt_3)
cyl_3 = Cylinder(Base=origin_point, Radius=column_radius_2, Length=ln_6)
end_2 = EndPoints(Curve=ln_6)  # -> Start, End
cir_6 = Circle(Plane=PlaneXY(0, 0, 0), Radius=column_radius_2)
cir_7 = Circle(Plane=end_2.End, Radius=column_radius_2)
planar_6 = PlanarSrf(Edges=cir_6)
planar_7 = PlanarSrf(Edges=cir_7)
join_3 = BrepJoin(Breps=[planar_6, planar_7, cyl_3])  # -> Breps, Closed

# ---- group: HEX BUILDING SYSTEM COMPONENTS / Hex Deck (Massive Solid)
planar_8 = PlanarSrf(Edges=polygon.Polygon)
Z_2 = UnitZ(Factor=deck_thickness_mm)
extr_2 = Extrude(Base=planar_8, Direction=Z_2)

# ---- group: HEX BUILDING SYSTEM COMPONENTS / + (Column Hole)
division_4 = Division(A=deck_thickness_mm, B=2)
pt_4 = PointXYZ(XComponent=x_coordinate, YComponent=y_coordinate, ZComponent=division_4, System=PlaneXY(0, 0, 0))
column_radius_3 = Number(section_radius_mm)
ln_7 = Line(StartPoint=origin_point, EndPoint=pt_4)
cyl_4 = Cylinder(Base=origin_point, Radius=column_radius_3, Length=ln_7)
end_3 = EndPoints(Curve=ln_7)  # -> Start, End
cir_8 = Circle(Plane=PlaneXY(0, 0, 0), Radius=column_radius_3)
cir_9 = Circle(Plane=end_3.End, Radius=column_radius_3)
planar_9 = PlanarSrf(Edges=cir_8)
planar_10 = PlanarSrf(Edges=cir_9)
join_4 = BrepJoin(Breps=[planar_9, planar_10, cyl_4])  # -> Breps, Closed
sdiff = SolidDifference(BrepsA=extr_2, BrepsB=join_4.Breps)

# ---- group: HEX BUILDING SYSTEM COMPONENTS / Roof Slope
base_hexagon = Curve(polygon.Polygon)
move = Move(Geometry=base_hexagon, Motion=Z_2)  # -> Geometry, Transform
pcen = PolygonCenter(Polyline=move.Geometry)  # -> CenterV, CenterE
cen = Center(Arc=cir_9)  # -> Center, Radius
ln_8 = Line(StartPoint=pcen.CenterE, EndPoint=cen.Center)
divide = DivideCurve(Curve=ln_8, Count=2, Kinks=False)  # -> Points, Tangents, Parameters
item_7 = ListItem(List=divide.Points, Index=1, Wrap=False)
wbpyramid = WeaverbirdsMeshPyramid(
    Plane=pcen.CenterE,
    Width=hexagon_radius_mm,
    NumberOfSides=nr_sides,
    TopPoint=item_7,
    BasePolygonMethod=False,
    FillStrategy=1)

# ----
# CLICK HERE TO GENERATE THE 2D FILE FOR CNC CUTTING!
bake_it = BooleanToggle(False)

# ----
# CLICK HERE TO GENERATE THE MESHES FOR 3D PRINTING!
bake_it_2 = BooleanToggle(False)

# ---- group: HEX BUILDING SYSTEM COMPONENTS / Object Seriation
multiplication_4 = Multiplication(A=section_radius_mm, B=6)
multiplication_5 = Multiplication(A=nr_hex_y_axis, B=nr_of_building_levels)
sqgrid = Square(Plane=origin_point, Size=multiplication_4, ExtentX=nr_hex_x_axis, ExtentY=multiplication_5)  # -> Cells, Points
pcen_2 = PolygonCenter(Polyline=sqgrid.Cells)  # -> CenterV, CenterE
move_2 = Move(Geometry=join.Breps, Motion=flatten(pcen_2.CenterV))  # -> Geometry, Transform

# ---- group: HEX BUILDING SYSTEM COMPONENTS / Nr. Y Grid Cells
multiplication_6 = Multiplication(A=nr_hex_y_axis, B=nr_of_building_levels)
multiplication_7 = Multiplication(A=nr_hex_x_axis, B=nr_hex_y_axis)
division_5 = Division(A=multiplication_7, B=nr_hex_x_axis)
subtraction = Subtraction(A=multiplication_6, B=division_5)

# ---- group: HEX BUILDING SYSTEM COMPONENTS / SolidToPrintableMesh Transformation
jagged = SettingsSpeed()
mesh = MeshBrep(Brep=sdiff, Settings=jagged)
mdif = MeshDifference(MeshesA=mesh, MeshesB=wbpyramid)

# ---- group: HEX BUILDING SYSTEM COMPONENTS / Object Seriation
multiplication_8 = Multiplication(A=hexagon_radius_mm, B=2.1)
sqgrid_2 = Square(Plane=origin_point, Size=multiplication_8, ExtentX=nr_hex_x_axis, ExtentY=nr_hex_y_axis)  # -> Cells, Points
pcen_3 = PolygonCenter(Polyline=sqgrid_2.Cells)  # -> CenterV, CenterE
move_3 = Move(Geometry=mdif, Motion=flatten(pcen_3.CenterV))  # -> Geometry, Transform

# ---- group: HEX BUILDING SYSTEM COMPONENTS / SolidToPrintableMesh Transformation
jagged_2 = SettingsSpeed()
mesh_2 = MeshBrep(Brep=move_2.Geometry, Settings=jagged_2)

# ---- group: Grid Components
hex_grid = Curve(hexa_grid.Cells)
center_points = Point(hexa_grid.Points)
hex_radius_2 = Line([ln, ln_2, ln_3])

# ---- group: Building Components
columns = Mesh(flatten(mesh_2))
hex_roof_decks = Mesh(flatten(move_3.Geometry))

# ---- group: HEX BUILDING SYSTEM COMPONENTS / Hex Radius
mcomp_2 = Decompose(Mesh=polygon.Polygon)  # -> Vertices, Faces, Colours, Normals
vertex_nr_7 = Slider(0, range=0..6)
item_8 = ListItem(List=mcomp_2.Vertices, Index=vertex_nr_7, Wrap=False)
ln_9 = Line(StartPoint=item_8, EndPoint=origin_point)
item_9 = Slider(0, range=0..1)

# ---- group: HEX BUILDING SYSTEM COMPONENTS / Hex Radius / Hex Polar Array
domain = Domain(Domain(0, 6.283185307))
range = Range(Domain=domain, Steps=6)
rotate = Rotate(Geometry=ln_9, Angle=range, Plane=origin_point)  # -> Geometry, Transform

# ---- group: HEX BUILDING SYSTEM COMPONENTS / Hex Radius (continued)
cull_i = CullIndex(List=rotate.Geometry, Indices=item_9, Wrap=False)

# ---- group: HEX BUILDING SYSTEM COMPONENTS / Hex Beams
division_6 = Division(A=b_flange_width_mm, B=2)
xy = XYPlane(Origin=origin_point)
Z_3 = UnitZ(Factor=h_section_height_m)
planar_11 = PlanarSrf(Edges=polygon.Polygon)
extr_3 = Extrude(Base=planar_11, Direction=Z_3)

# ---- group: HEX BUILDING SYSTEM COMPONENTS / + Embedded Part (in Hex Beams Framework)
division_7 = Division(A=b_flange_width_mm, B=2)
xy_2 = XYPlane(Origin=origin_point)
division_8 = Division(A=h_section_height_m, B=3)
Z_4 = UnitZ(Factor=slab_thickness_mm)
Z_5 = UnitZ(Factor=division_8)
item_10 = Slider(0, range=0..1)
Z_6 = UnitZ(Factor=thickness_mm)

# ---- group: HEX BUILDING SYSTEM COMPONENTS / Tri-Grid Modulated Floor / Floor
xy_3 = XYPlane(Origin=origin_point)
Z_7 = UnitZ(Factor=thickness_mm)

# ---- group: Bake!
# To use the predefined BAKE component DOWNLOAD LunchBox plugin v0.35 for Grasshopper
# 
# (by Nathan Miller @archinate)
# 
# http://wiki.theprovingground.org/plugin-tpg
# Otherwise just generate the desired component doing right click and pressing 'bake' on the component collection outputs.
crv = Curve(flatten([square_base_plate, circular_holes]))
# Weaverbird plugin is also needed!
# 
# http://www.giuliopiacentino.com/weaverbird/
panel_2 = Panel("CUT")
bake = ObjectBake(
    BakeToggle=bake_it,
    GeometryObjects=crv,
    Layer=panel_2,
    ObjectName=panel_2,
    ObjectColor=RGB(255, 0, 0),
    LayerColor=RGB(255, 0, 0))
crv_2 = Curve(flatten([hex_grid, hex_radius_2]))
bake_2 = ObjectBake(
    BakeToggle=bake_it,
    GeometryObjects=crv_2,
    Layer="ENGRAVE 1 (DEEP)",
    ObjectName="ENGRAVE 1 (DEEP)",
    ObjectColor=RGB(0, 255, 0),
    LayerColor=RGB(0, 255, 0))

# To use the predefined BAKE component DOWNLOAD LunchBox plugin v0.35 for Grasshopper
# 
# (by Nathan Miller @archinate)
# 
# http://wiki.theprovingground.org/plugin-tpg
panel_3 = Panel("3D COLUMNS")
bake_3 = ObjectBake(
    BakeToggle=bake_it_2,
    GeometryObjects=columns,
    Layer=panel_3,
    ObjectName=panel_3,
    ObjectColor=RGB(0, 0, 255),
    LayerColor=RGB(0, 0, 255))
bake_4 = ObjectBake(
    BakeToggle=bake_it_2,
    GeometryObjects=hex_roof_decks,
    Layer="3D DECKS",
    ObjectName="3D DECKS",
    ObjectColor=RGB(255, 150, 0),
    LayerColor=RGB(255, 150, 0))

# ---- group: HEX BUILDING SYSTEM COMPONENTS / Tri-Grid Modulated Floor / Hex Polar Array
domain_2 = Domain(Domain(0, 6.283185307))
range_2 = Range(Domain=domain_2, Steps=6)

# ---- group: HEX BUILDING SYSTEM COMPONENTS / Tri-Grid Modulated Floor
item_11 = Slider(0, range=0..1)

# ---- group: HEX BUILDING SYSTEM COMPONENTS / + Embedded Part (in Hex Beams Framework) / Hex Polar Array
domain_3 = Domain(Domain(0, 6.283185307))
range_3 = Range(Domain=domain_3, Steps=6)

# ---- group: HEX BUILDING SYSTEM COMPONENTS / Hex Beams / Hex Polar Array
domain_4 = Domain(Domain(0, 6.283185307))
range_4 = Range(Domain=domain_4, Steps=6)

# ---- group: HEX GRID COMPONENTS / Tri-Grid Modulation
flatten_2 = FlattenTree(Data=item, Path="{0}")
flatten_3 = FlattenTree(Data=item_2, Path="{0}")
item_12 = ListItem(List=flatten_2, Index=0, Wrap=False)
item_13 = ListItem(List=flatten_3, Index=0, Wrap=False)
origin_point_2 = Point(origin)
ln_10 = Line(StartPoint=origin_point_2, EndPoint=item_12)
ln_11 = Line(StartPoint=origin_point_2, EndPoint=item_13)
ln_12 = Line(StartPoint=item_12, EndPoint=item_13)
wbweave = WeaverbirdSMeshFromLinesWeaveBack(Lines=[ln_10, ln_11, ln_12], MaximumValence=4)
wbtriangles = WeaverbirdsSplitTrianglesSubdivision(MeshCurves=wbweave, Level=nr_subdivisions)

# ---- group: HEX BUILDING SYSTEM COMPONENTS / Tri-Grid Modulated Floor / Floor (continued)
wbfacepolys = WeaverbirdsFacePolylines(Mesh=wbtriangles)
offset = Offset(Curve=wbfacepolys, Distance=gap_width_mm, Plane=xy_3, Corners=1)
planar_12 = PlanarSrf(Edges=offset)
extr_4 = Extrude(Base=planar_12, Direction=Z_7)

# ---- group: HEX BUILDING SYSTEM COMPONENTS / Tri-Grid Modulated Floor / Hex Polar Array (continued)
rotate_2 = Rotate(Geometry=extr_4, Angle=range_2, Plane=origin_point)  # -> Geometry, Transform

# ---- group: HEX BUILDING SYSTEM COMPONENTS / Tri-Grid Modulated Floor (continued)
cull_i_2 = CullIndex(List=rotate_2.Geometry, Indices=item_11, Wrap=False)

# ---- group: HEX GRID COMPONENTS / Tri-Grid Modulation / Hex Polar Array
domain_5 = Domain(Domain(0, 6.283185307))
range_5 = Range(Domain=domain_5, Steps=6)
rotate_3 = Rotate(Geometry=wbtriangles, Angle=range_5, Plane=origin_point_2)  # -> Geometry, Transform

# ---- group: HEX GRID COMPONENTS / Tri-Grid Modulation (continued)
cull_i_3 = CullIndex(List=rotate_3.Geometry, Indices=0, Wrap=False)
mjoin = MeshJoin(Meshes=cull_i_3)
move_object_geometry_to_point = MoveToPoint(geometry_to_move=mjoin, geometry_you_want_to_move=mjoin, point=center_points)  # -> new_geometry, transform_data
wbedges = WeaverbirdsMeshEdges(MeshOrPolylines=move_object_geometry_to_point.new_geometry, FaceOrder=False)

# ---- group: Grid Components (continued)
tri_grid_modulation = Curve(wbedges)

# ---- group: Bake! (continued)
crv_3 = Curve(flatten(tri_grid_modulation))
bake_5 = ObjectBake(
    BakeToggle=bake_it,
    GeometryObjects=crv_3,
    Layer="ENGRAVE 2 (SOFT)",
    ObjectName="ENGRAVE 2 (SOFT)",
    ObjectColor=RGB(255, 255, 0),
    LayerColor=RGB(255, 255, 0))

# ---- group: HEX BUILDING SYSTEM COMPONENTS / Hex Beams (continued)
wbfacepolys_2 = WeaverbirdsFacePolylines(Mesh=wbweave)
offset_2 = Offset(Curve=wbfacepolys_2, Distance=division_6, Plane=xy, Corners=1)
planar_13 = PlanarSrf(Edges=offset_2)
extr_5 = Extrude(Base=planar_13, Direction=Z_3)

# ---- group: HEX BUILDING SYSTEM COMPONENTS / Hex Beams / Hex Polar Array (continued)
rotate_4 = Rotate(Geometry=extr_5, Angle=range_4, Plane=origin_point)  # -> Geometry, Transform

# ---- group: HEX BUILDING SYSTEM COMPONENTS / Hex Beams (continued)
cull_i_4 = CullIndex(List=rotate_4.Geometry, Indices=0, Wrap=False)
sdiff_2 = SolidDifference(BrepsA=extr_3, BrepsB=cull_i_4)

# ---- group: HEX BUILDING SYSTEM COMPONENTS / Hex Beams Framework (Solid)
sdiff_3 = SolidDifference(BrepsA=sdiff_2, BrepsB=join_2.Breps)

# ---- group: HEX BUILDING SYSTEM COMPONENTS / Object Seriation
multiplication_9 = Multiplication(A=hexagon_radius_mm, B=2.1)
sqgrid_3 = Square(Plane=origin_point, Size=multiplication_9, ExtentX=nr_hex_x_axis, ExtentY=subtraction)  # -> Cells, Points
pcen_4 = PolygonCenter(Polyline=sqgrid_3.Cells)  # -> CenterV, CenterE
move_4 = Move(Geometry=sdiff_3, Motion=flatten(pcen_4.CenterV))  # -> Geometry, Transform

# ---- group: HEX BUILDING SYSTEM COMPONENTS / SolidToPrintableMesh Transformation
jagged_3 = SettingsSpeed()
mesh_3 = MeshBrep(Brep=move_4.Geometry, Settings=jagged_3)

# ---- group: Building Components (continued)
hex_beams = Mesh(flatten(mesh_3))

# ---- group: HEX BUILDING SYSTEM COMPONENTS / + Embedded Part (in Hex Beams Framework) (continued)
wbfacepolys_3 = WeaverbirdsFacePolylines(Mesh=wbweave)
offset_3 = Offset(Curve=wbfacepolys_3, Distance=division_7, Plane=xy_2, Corners=1)
planar_14 = PlanarSrf(Edges=offset_3)
move_5 = Move(Geometry=planar_14, Motion=Z_4)  # -> Geometry, Transform
extr_6 = Extrude(Base=move_5.Geometry, Direction=Z_5)

# ---- group: HEX BUILDING SYSTEM COMPONENTS / + Embedded Part (in Hex Beams Framework) / Hex Polar Array (continued)
rotate_5 = Rotate(Geometry=extr_6, Angle=range_3, Plane=xy_2)  # -> Geometry, Transform

# ---- group: HEX BUILDING SYSTEM COMPONENTS / + Embedded Part (in Hex Beams Framework) (continued)
cull_i_5 = CullIndex(List=rotate_5.Geometry, Indices=item_10, Wrap=False)
sunion = SolidUnion(Breps=flatten([cull_i_5, extr]))
move_6 = Move(Geometry=sunion, Motion=Z_6)  # -> Geometry, Transform

# ---- group: HEX BUILDING SYSTEM COMPONENTS / Slab + Floor (Solid)
sunion_2 = SolidUnion(Breps=flatten([move_6.Geometry, cull_i_2]))
sdiff_4 = SolidDifference(BrepsA=sunion_2, BrepsB=join_3.Breps)

# ---- group: HEX BUILDING SYSTEM COMPONENTS / Object Seriation
multiplication_10 = Multiplication(A=hexagon_radius_mm, B=2.1)
sqgrid_4 = Square(Plane=origin_point, Size=multiplication_10, ExtentX=nr_hex_x_axis, ExtentY=subtraction)  # -> Cells, Points
pcen_5 = PolygonCenter(Polyline=sqgrid_4.Cells)  # -> CenterV, CenterE
move_7 = Move(Geometry=sdiff_4, Motion=flatten(pcen_5.CenterV))  # -> Geometry, Transform

# ---- group: HEX BUILDING SYSTEM COMPONENTS / SolidToPrintableMesh Transformation
jagged_4 = SettingsSpeed()
mesh_4 = MeshBrep(Brep=move_7.Geometry, Settings=jagged_4)

# ---- group: Building Components (continued)
hex_slabs = Mesh(flatten(mesh_4))

# ---- group: Bake! (continued)
bake_6 = ObjectBake(
    BakeToggle=bake_it_2,
    GeometryObjects=hex_beams,
    Layer="3D BEAMS",
    ObjectName="3D BEAMS",
    ObjectColor=RGB(255, 0, 0),
    LayerColor=RGB(255, 0, 0))
bake_7 = ObjectBake(
    BakeToggle=bake_it_2,
    GeometryObjects=hex_slabs,
    Layer="3D SLABS",
    ObjectName="3D SLABS",
    ObjectColor=RGB(255, 255, 0),
    LayerColor=RGB(255, 255, 0))

# ==== cluster MoveToPoint: Moves geometry/object to a point
geometry_you_want_to_move = ClusterInput()  # Geometry You Want To Move
point = ClusterInput()  # Reference a point from Rhino or Grasshopper where you want the object to move to
pcomp = Decompose(Point=point, System=PlaneXY(0, 0, 0))  # -> XComponent, YComponent, ZComponent
area = Area(GeometryYouWantToMove=geometry_you_want_to_move)  # -> Area, Centroid
geometry_to_move = ClusterInput()  # Geometry to Move
vec = VectorXYZ(XComponent=pcomp.XComponent, YComponent=pcomp.YComponent, ZComponent=pcomp.ZComponent)  # -> Vector, Length
vec2pt = Vector2Pt(PointA=area.Centroid, PointB=vec.Vector, Unitize=False)  # -> Vector, Length
move = Move(GeometryToMove=geometry_to_move, Motion=vec2pt.Vector)  # -> NewGeometry, TransformData
new_geometry = ClusterOutput(move.NewGeometry)  # The final geometry, moved to new local
transform_data = ClusterOutput(move.TransformData)  # Transform Data (the X output of Move Base Component)
